# Grasshopper definition Week1_all.gh (Grasshopper 1.0.8)

point_vector = Python3Script()  # -> out, moved, base
# ---------- point_vector: Python ----------
import Rhino.Geometry as geo

base = geo.Point3d(0, 0, 0)
vec = geo.Vector3d(10, 5, 3)
moved = base + vec
# ---------- end point_vector ----------
curve = Python3Script()  # -> out, pts, curve, rail, surface
# ---------- curve: Python ----------
import Rhino.Geometry as geo

pts = [geo.Point3d(i, i*i*0.1, 0) for i in range(-6, 6)]
curve = geo.NurbsCurve.Create(False, 3, pts)

rail = geo.Line(geo.Point3d(0,0,0), geo.Point3d(0,0,10)).ToNurbsCurve()
surface = geo.Surface.CreateExtrusion(curve, geo.Vector3d(0,0,5))
# ---------- end curve ----------
brep = Python3Script()  # -> out, sphere, brep, brep_x
# ---------- brep: Python ----------
import Rhino.Geometry as geo

sphere = geo.Sphere(geo.Point3d(0,0,0), 5)
brep = geo.Brep.CreateFromSphere(sphere)
xform = geo.Transform.Translation(10, 0, 0)
brep_x = brep.Duplicate()
brep_x.Transform(xform)
# ---------- end brep ----------
py3 = Python3Script(x=Slider(3, range=0..10), y=Slider(4, range=0..10))  # -> out, a
# ---------- py3: Python ----------
print(x)
print(y)
print("X+Y = ", x+y)

a = x + y
# ---------- end py3 ----------
geo = Geometry(brep.brep_x)
geo_2 = Geometry(brep.brep)
geo_3 = Geometry(brep.sphere)
geo_4 = Geometry(curve.pts)
geo_5 = Geometry(curve.rail)
geo_6 = Geometry(curve.surface)
geo_7 = Geometry(curve.curve)
geo_8 = Geometry(point_vector.base)
geo_9 = Geometry(point_vector.moved)
panel = Panel(py3.out)
panel_2 = Panel(py3.a)
brep_2 = Python3Script(script=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)  # -> out, sphere, brep, brep_x; same code as brep
curve_2 = Python3Script(script=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)  # -> out, pts, curve, rail, surface
#   port script: Script to execute
# ---------- curve_2: Python ----------
import Rhino.Geometry as geo

pts = [geo.Point3d(i, i*i*0.1, 0) for i in range(-5, 6)]
curve = geo.NurbsCurve.Create(False, 3, pts)

rail = geo.Line(geo.Point3d(0,0,0), geo.Point3d(0,0,10)).ToNurbsCurve()
surface = geo.Surface.CreateExtrusion(curve, geo.Vector3d(0,0,5))
# ---------- end curve_2 ----------
point_vector_2 = Python3Script(script={MarshGuids=True, MarshInputs=True, MarshOutputs=True, Text="aW1wb3J0IFJoaW5vLkdlb21ldHJ5IGFzIGdlbw0KDQpiYXNlID0gZ2VvLlBvaW50M2QoMCwgMCwgMCkNCnZlYyA9IGdlby5WZWN0b3IzZCgxMCwgNSwgMykNCm1vdmVkID0gYmFzZSArIHZlYw0K", Title="01_points_vectors.py", Uri="file:///C:/Users/bsh96/Documents/GitHub/DesignAutomationLecture/Week1_Geometry_Basics/01_points_vectors.py", Taxon="*.*.python"})  # -> out, moved, base; same code as point_vector
geo_10 = Geometry(point_vector_2.moved)
geo_11 = Geometry(point_vector_2.base)
geo_12 = Geometry(curve_2.rail)
geo_13 = Geometry(curve_2.surface)
geo_14 = Geometry(brep_2.sphere)
geo_15 = Geometry(curve_2.pts)
geo_16 = Geometry(curve_2.curve)
geo_17 = Geometry(brep_2.brep)
geo_18 = Geometry(brep_2.brep_x)
panel_3 = Panel(point_vector_2.out)
